# Grasshopper definition gh_test_from_csv.gh (Grasshopper 1.0.8)

F = File("C:\Users\Adi.Muff\Desktop\leader_leader_export.csv")
file = ReadFile(File=F, PerLineParse=True)
S = Script(csv_path=F, out_folder="C:\Users\Adi.Muff\Desktop\123", use_plan_dims=Toggle(True), name_fields_str=file)  # -> out, preview, report; inputs csv_path: String, out_folder: String, name_fields_str: String
# ---------- S: Python ----------
import os, System, csv
import Rhino
import Rhino.Geometry as rg

def to_float(val):
    if val is None: return None
    s = str(val).strip()
    if s == "" or s.upper() == "NA": return None
    s2 = s.replace(",", ".")
    try: return float(s2)
    except: return None

def read_csv_table(path):
    with open(path, "r", encoding="utf-8") as f:
        rdr = csv.reader(f, delimiter=",", quotechar='"')
        header = next(rdr, [])
        rows = [row for row in rdr]
    return header, rows

def row_to_dict(header, row):
    d = {}
    for i, h in enumerate(header):
        k = str(h).strip()
        if not k: continue
        d[k] = row[i] if i < len(row) else ""
    return d

def select_value(d, keys):
    for k in keys:
        v = d.get(k, "")
        if str(v).strip() != "": return v
    return None

def build_door_geometry(width, height, panel_thickness, frame_depth, extrusion_depth):
    rect_panel = rg.Rectangle3d(rg.Plane.WorldXY, width, height)
    crv_panel = rect_panel.ToNurbsCurve()
    panel = rg.Extrusion.Create(crv_panel, extrusion_depth or 10.0, True)

    outer_w = width + frame_depth
    outer_h = height + frame_depth
    rect_outer = rg.Rectangle3d(rg.Plane.WorldXY, outer_w, outer_h)
    rect_inner = rg.Rectangle3d(rg.Plane.WorldXY, width, height)
    crv_outer = rect_outer.ToNurbsCurve()
    crv_inner = rect_inner.ToNurbsCurve()
    curves = System.Array[rg.Curve]([crv_outer, crv_inner])
    breps = rg.Brep.CreatePlanarBreps(curves, Rhino.RhinoDoc.ActiveDoc.ModelAbsoluteTolerance)
    frame = None
    if breps and len(breps) > 0:
        face = breps[0].Faces[0].DuplicateFace(False)
        frame = rg.Extrusion.Create(face, extrusion_depth or 10.0, True)
    return panel, frame

def safe_filename(parts):
    out = []
    for p in parts:
        if not p: continue
        s = str(p)
        for ch in '\\/:*?"<>|':
            s = s.replace(ch, "-")
        out.append(s)
    return "_".join(out) if out else None

def make_name(d, fields, idx):
    parts = []
    for f in fields:
        v = d.get(f)
        if v is not None and str(v).strip() != "": parts.append(str(v).strip())
    nm = safe_filename(parts)
    if nm: return nm
    if d.get("LeaderGUID"): return safe_filename([d["LeaderGUID"]]) or ("item_%03d" % (idx+1))
    if d.get("text"): return safe_filename([d["text"]]) or ("item_%03d" % (idx+1))
    return "item_%03d" % (idx+1)

# Inputs expected from GH:
# csv_path: str
# out_folder: str
# use_plan_dims: bool
# name_fields_str: str  e.g. "text,LeaderGUID"
# panel_t: float
# frame_d: float
# extr_d: float

preview = []
rep = []

if not csv_path or not os.path.isfile(csv_path):
    rep.append("CSV not found: %s" % csv_path)
else:
    try:
        header, rows = read_csv_table(csv_path)
    except Exception as e:
        rep.append("CSV read failed: %s" % e)
        rows = []

    name_fields = [s.strip() for s in (name_fields_str or "").split(",") if s.strip()]
    if not name_fields: name_fields = ["text"]

    w_keys = ["Mauerlichtbreite_plan","Mauerlichtbreite_Massaufnahme"] if use_plan_dims else ["Mauerlichtbreite_Massaufnahme","Mauerlichtbreite_plan"]
    h_keys = ["Mauerlichthöhe_plan","Mauerlichthöhe_Massaufnahme","Mauerlichthöhe_Massaufnahme_ab_MtR"] if use_plan_dims else ["Mauerlichthöhe_Massaufnahme","Mauerlichthöhe_Massaufnahme_ab_MtR","Mauerlichthöhe_plan"]

    if rows:
        if not out_folder or not os.path.isdir(out_folder):
            rep.append("No out_folder or not a directory – writing skipped (preview only)")

    for i,row in enumerate(rows):
        d = row_to_dict(header, row)
        w = to_float(select_value(d, w_keys))
        h = to_float(select_value(d, h_keys))
        if w is None or h is None:
            rep.append("Row %d skipped (missing width/height)" % (i+1))
            continue

        pt = panel_t if panel_t is not None else 40.0
        fd = frame_d if frame_d is not None else 60.0
        ed = extr_d if extr_d is not None else 10.0

        panel, frame = build_door_geometry(w, h, pt, fd, ed)
        if panel: preview.append(panel)
        if frame: preview.append(frame)

        if out_folder and os.path.isdir(out_folder):
            fname = make_name(d, name_fields, i)
            path = os.path.join(out_folder, fname + ".3dm")
            try:
                model = Rhino.FileIO.File3dm()
                if panel: model.Objects.Add(panel)
                if frame: model.Objects.Add(frame)
                model.Write(path, 6)
                rep.append("Saved: %s" % path)
            except Exception as e:
                rep.append("Write failed (%s): %s" % (fname, e))

report = "\n".join(rep)
# ---------- end S ----------
